% Simulink data dictionary FoCFpgaData.sldd

PU_System = struct(V_base=13.85641, I_base=5, N_base=4970, T_base=0.1653987, P_base=103.923)

adc = struct(
  TransducerVoltPerAmpere=[1 1],
  TransducerVoltAtZeroAmpere=[0 0],
  CountMin=0,
  CountMax=65535,
  CountPerTransducerVolt=-1024,
  CountAtZeroTransducerVolt=32868)

enHwSwMaskDisplay = true

encoder = struct(
  RotorPositionAtIndex=0,
  ALeadsB=false,
  NumberOfSlits=1250,
  CountPerRevolution=5000,
  RotorPositionResolution=0.001256637,
  PositionValidAtStartup=false,
  DebounceCount=20)

inverter = struct(V_dc=24, ISenseMax=5, GatesActiveHigh=true, GatesComplementary=false, R_board=0.0001)

inputSourceEnum = enum(DefaultValue="StandAloneTest", AddClassNameToEnumNames=true)  % Input type enumeration
  StandAloneTest = 0  % Type: Stand alone
  InteractiveUserInput = 1  % Type: Interactive

pmsm = struct(
  model="Anaheim-BLY172S-24V-4000",
  sn="002",
  p=4,
  Rs=0.4,
  Ld=0.0006,
  Lq=0.0006,
  J=4.8018552467e-6,
  B=9.6037104933e-6,
  Ke=4,
  Kt=0.04103,
  I_rated=3.5,
  N_max=10000,
  PositionOffset=0.1712,
  QEPSlits=1250,
  FluxPM=0.005513289,
  T_rated=0.1157791,
  N_base=5040)

pwm = struct(
  TimePerCount=2.0e-8,
  Period=4.0e-5,
  CountPerPeriod=2000,
  CounterMax=1000,
  DeadTimeCount=5,
  DeadTimeSec=1.0e-7)

sampleTime = struct(
  CurrentControl=4.0e-5,
  OverCurrentDetector=4.0e-5,
  EncoderPosition=4.0e-5,
  OpenLoopVelocityControl=0.001,
  VelocityControl=0.001,
  EncoderCalibration=0.001,
  PwmPeripheral=2.0e-8,
  EncoderPeripheral=2.0e-8,
  AdcPeripheral=2.0e-8,
  MotorControlFpgaClock=2.0e-8)

dataRange = struct(
  RotorVelocity=struct(Max=800, Min=-800),
  PhaseCurrent=struct(Max=12, Min=-12),
  PhaseVoltage=struct(Max=12, Min=-12),
  DqVoltage=struct(Max=13.85641, Min=-13.85641),
  EncoderCount=struct(Max=8000, Min=0))

paramAdcEnablecalibration = Simulink.Parameter(1, Min=0, Max=1)  % % Enable ADC Calibration
paramAdcCalibrationSamples = Simulink.Parameter(16, Min=8, Max=48)  % Samples for ADC  Calibration
paramAdcAmperePerCount = Simulink.Parameter([-0.00097656 -0.00097656], Min=-0.04705882, Max=0.04705882)  % ADC count to current scalar
paramAdcCountAtZeroAmpere = Simulink.Parameter([32868 32868], Min=0, Max=65535)  % ADC count bias for current measurement
paramCurrentControlSatVoltage = Simulink.Parameter(13.85641, Min=-13.85641, Max=13.85641)  % Maximum voltage amplitude output from current controller
paramEncoderCalibrateAtStartup = Simulink.Parameter(1, Min=0, Max=1)  % Enable encoder calibration at startup
paramEncoderCalibrationDuration = Simulink.Parameter(0.2, Min=0, Max=1)  % Duration where error must be less than max during encoder calibration
paramEncoderCalibrationMaxError = Simulink.Parameter(0.001256637, Min=0, Max=0.006283185)  % Max error for position to be valid during encoder calibration
paramEncoderCalibrationVoltage = Simulink.Parameter(2, Min=-12, Max=12)  % Voltage applied during encoder calibration
paramEncoderRotorPositionAtZeroCount = Simulink.Parameter(0, Min=-6.283185, Max=6.283185)  % Encoder count to rotor position bias
paramEncoderRotorPositionPerCount = Simulink.Parameter(0.001256637, Min=0.0007853982, Max=0.006283185)  % Encoder count to rotor position scalar
paramOpenLoopVelocityAcceleration = Simulink.Parameter(40, Min=0, Max=100)  % Acceleration during open loop velocity control
paramOpenLoopVelocityToVoltsBias = Simulink.Parameter(0.4, Min=0, Max=2000)  % Bias to convert velocity to voltage in open loop
paramOpenLoopVelocityToVoltsScalar = Simulink.Parameter(0.04, Min=0, Max=12)  % Scalar to convert velocity to voltage in open loop
paramOverCurrentDuration = Simulink.Parameter(0.05, Min=0, Max=1)  % Over current detection minimum duration
paramOverCurrentEnable = Simulink.Parameter(0, Min=0, Max=1)  % Enable over current detection
paramOverCurrentLimit = Simulink.Parameter(10.45, Min=-12, Max=12)  % Over current detection threshold limit
paramPwmCompareAtZeroVolt = Simulink.Parameter(500, Min=0, Max=5000)  % PWM counter value representing zero volts (PMW counter max/2)
paramPwmCompareMax = Simulink.Parameter(1000, Min=0, Max=10000)  % Maximum value to compare against PWM counter
paramPwmComparePerVolt = Simulink.Parameter(41.66667, Min=0, Max=416.6667)  % Voltage to PWM counter scalar (PWM counter max/bus voltage)

PI_params = struct(
  T1=0.00048,
  T2=0.00048,
  delay_IIR=0.192,
  damping=0.7071068,
  x=1.2,
  sigma=0.00048,
  Ti_i=0.001499625,
  Ti_id=0.001499625,
  Kp_i=0.2255274,
  Ki_i=150.3892,
  Kp_id=0.2255274,
  Ki_id=150.3892,
  Ki_texas=0.32008,
  Ki_d_texas=0.32008,
  delta=0.21448,
  Ti_speed=0.3088512,
  Kp_speed=0.09403111,
  Ki_speed=0.3044544,
  Ki_speed_texas=0.003237805,
  gamma=0.19248,
  Kp_fwc=0.003895535,
  Ki_fwc=2.597672,
  Ti_fwc=0.001499625)

paramVelocityControlSatCurrent = Simulink.Parameter(3.5, Min=-12, Max=12)  % Maximum voltage amplitude output from velocity controller

commandTypeEnum = enum(DefaultValue="Error", AddClassNameToEnumNames=true)  % Command type enumeration
  Error = 0  % Command: Error
  OpenLoopVelocity = 1  % Command: Open-loop velocity control
  CalibrateEncoder = 2  % Command: Calibrate encoder
  Velocity = 3  % Command: Closed-Loop velocity control